# Grasshopper definition Pu.gh (Grasshopper 0.9.76)
# plug-ins: VirtualWindTunnel

panel = Panel("C:\MeshingPaper\Pu\")
# 40
number_slider = Slider(0.066, range=0..0.1)
# 80
number_slider_2 = Slider(0.033, range=0..0.1)
# 20
number_slider_3 = Slider(0.132, range=0..1)
# 10
number_slider_4 = Slider(0.264, range=0..1)
number_slider_5 = Slider(1, range=0..1)
toggle = BooleanToggle(False)
wind_dir = ControlKnob(Decimals=0, Limit=True, Maximum=359, Minimum=0, Range=360, Value=0)
geo = Geometry(<mesh referenced from the Rhino model>)
domaincyl = DomainCyl(
    Geometry=geo,
    Directory="C:\MeshingPaper\test\",
    WindDir=wind_dir,
    DivisionsOuterCirc="15",
    DivisionsZ=10,
    ScaleInnerR=Slider(0.095, range=0..1),
    RAM=number_slider_5,
    CPUs=number_slider_5,
    Run=toggle)  # -> Out, Domain, Cyl
clean = Clean(Dir="C:\MeshingPaper\test\", Run=Button())
number_slider_6 = Slider(0.1, range=0..5)  # disabled
cellsize = CellSize(Domain=domaincyl.Domain, BlockMeshCellSize="0.0256232426078395", DesiredCellSize="0.00625")
number_slider_7 = Slider(2, range=0..10)
# zCells
cluster = Cluster_2(x=domaincyl.Domain)
brep = Brep(<brep referenced from the Rhino model>)  # disabled
panel_2 = Panel(cellsize)
panel_3 = Panel(cluster)
cluster_2 = Cluster(B=brep, min_edge=number_slider_6, max_edge=number_slider_6)  # disabled
crv = Curve(<curve referenced from the Rhino model>)
divide = DivideCurve(Curve=crv, Count=Slider(50, range=0..100), Kinks=False)  # -> Points, Tangents, Parameters
mesh = Mesh(
    Domain=domaincyl.Domain,
    AccBuilding=number_slider_7,
    AccFeatures=number_slider_7,
    AccGround=Slider(2, range=0..10),
    Layer=Slider(3, range=0..10),
    Run=toggle)  # -> Out, Domain
toggle_2 = BooleanToggle(True)
number_slider_8 = Slider(0.019, range=0..1)
probes = Probes(Domain=domaincyl.Domain, Points=cluster_2, PointName=1, Run=toggle_2)  # disabled
probes_2 = Probes(Domain=domaincyl.Domain, Points=divide.Points, PointName=1, Run=toggle_2)
gradient = Gradient(
    LowerLimit=Slider(0, range=0..10),
    UpperLimit=Slider(13, range=0..25),
    Parameter=probes_2,
    stops=[0: RGB(0, 128, 0), 0.5: RGB(255, 255, 0), 1: RGB(255, 0, 0)])
abl = ABL(
    Uref=Slider(12, range=0..100),
    Zref=Slider(0.5, range=0..100),
    Z0=Slider(0.005, range=0..100),
    ZGround=Slider(0, range=0..100))
button = Button()
multiplication = Multiplication(A=probes, B=number_slider_8)  # disabled
multiplication_2 = Multiplication(A=probes_2, B=number_slider_8)
simulation = Simulation(
    Domain=mesh.Domain,
    Iterations=Slider(7659, range=0..10000),
    WriteInterval=Slider(26, range=0..100),
    KeepTimeSteps=Slider(4, range=0..10),
    Mode=0,
    Bcond=abl,
    Run=toggle)
vdisex = VectorDisplayEx(Point=divide.Points, Vector=multiplication_2, Colour=gradient, Width=2)
residualwriter = ResidualWriter(WorkingDir="C:\MeshingPaper\test\", Mode=0)
vdisex_2 = VectorDisplayEx(Point=cluster_2, Vector=multiplication, Colour=gradient, Width=2)

# ==== cluster Cluster
min_edge = ClusterInput()
max_edge = ClusterInput()
B = ClusterInput()
custom_mesh_settings = SettingsCustom(
    StitchSeams=True,
    SimplePlanes=False,
    Refine=True,
    MinCount=16,
    MaxCount=400,
    AspectRatio=20,
    MaxDistance=0,
    MaxAngle=20,
    MinEdge=min_edge,
    MaxEdge=max_edge)
mesh = MeshBrep(Brep=B, Settings=custom_mesh_settings)
demesh = DeconstructMesh(Mesh=mesh)  # -> Vertices, Faces, Colours, Normals
V = ClusterOutput(demesh.Vertices)

# ==== cluster Cluster_2
x = ClusterInput()
python = PythonScript(x=x)  # -> out, a
# ---------- python: Python ----------
a = x.cellSizeInner;
# ---------- end python ----------
division = Division(A="1.5", B=python.a)
round = Round(Number=division)  # -> Nearest, Floor, Ceiling
N = ClusterOutput(round.Nearest)
