# Grasshopper definition testFile.gh (Grasshopper 0.9.76)
# plug-ins: Python Interpreter, VirtualWindTunnel

brep = Brep(<brep referenced from the Rhino model>)
xz = XZPlane(Origin=Point(-0.0485980799, -4.042677826, 0))
clean = Clean(Dir="C:\OF2\", Run=Button())
domain = Domain(
    Geometry=brep,
    Directory="C:\OF2\",
    Mode=1,
    BaseMesh=Slider(10, range=0..100),
    RAM=Slider(27836, range=0..64000),
    CPUs=Slider(1, range=1..8),
    Run=Toggle(True))  # -> Out, Domain, Cyl
c_script = CSharpScript(b=brep, p=xz)  # -> out, B, A; inputs b: list of Brep, p: Plane
# ---------- c_script: C# ----------
    double pj = 0;
    A = FindFacades(p, b, out pj);
    B = pj;
# ---------- c_script: C# additional code ----------
  static List<Brep> FindFacades(Plane plane, List<Brep> volumes, out double projectedAreaTotal)
  {
    List<Brep> Facades = new List<Brep>();

    List<double> projectedAreas = new List<double>();
    foreach (Brep b in volumes)
    {
      for (int i = 0; i < b.Faces.Count; i++)
      {
        Vector3d vSurf = b.Faces[i].NormalAt(0.5, 0.5);
        double dot = plane.ZAxis * vSurf;
        if (dot < 0.1) continue;


        Brep face = b.Faces[i].DuplicateFace(false);
        //Print(dot + "");
        Facades.Add(face);
        
        Vector3d cross = Vector3d.CrossProduct(plane.ZAxis, vSurf);
        double norm = cross.Length;
        double angle = Math.Atan2(norm, dot);

        //Print((angle * 180 / Math.PI) + "");

        double projectedArea = face.GetArea() * Math.Cos(angle);

        projectedAreas.Add(projectedArea);
        //Print(projectedArea + "");
      }
    }
    projectedAreaTotal = projectedAreas.Sum(x => x);

    return Facades;
  }
# ---------- end c_script ----------
panel = Panel(c_script.B)
c_script_2 = CSharpScript(b=brep)  # -> out, B, A; inputs b: Box; disabled
# ---------- c_script_2: C# ----------
    B = b.GetCorners();
# ---------- end c_script_2 ----------
python = PythonScript()  # -> out, a, b, c, d, e, f
# ---------- python: Python ----------
a=x.BBox
b=x.centerGroundBBox
c=x.BBox.Min
d=x.BBox.Max
e=x.dimY
f=x.newBoxDomain.GetCorners
# ---------- end python ----------
mesh = Mesh(Domain=domain.Domain, Accuracy=Slider(3, range=0..10), Run=Toggle(False))  # -> Out, Domain
panel_2 = Panel(python.b)
panel_3 = Panel(python.f)
panel_4 = Panel(python.a)
panel_5 = Panel(python.c)
panel_6 = Panel(mesh.Out)
simulation = Simulation(
    Iterations=Slider(1000, range=0..1000),
    WriteInterval=Slider(20, range=0..100),
    KeepTimeSteps=Slider(5, range=0..10),
    Run=Toggle(False))
number_slider = Slider(14, range=1..100)  # disabled
number_slider_2 = Slider(32, range=1..100)  # disabled
pt = ConstructPoint(XCoordinate=0, YCoordinate=0, ZCoordinate=0)  # disabled
neg = Negative(Value=number_slider)  # disabled
xy = XYPlane(Origin=pt)  # disabled
dom = ConstructDomain(DomainStart=neg, DomainEnd=number_slider)  # disabled
circle = CircleCNR(Center=pt, Normal=Vector(0, 0, 1), Radius=number_slider_2)  # disabled
rectangle = Rectangle(Plane=xy, XSize=dom, YSize=dom, Radius=0)  # -> Rectangle, Length; disabled
Y = UnitY(Factor=number_slider_2)  # disabled
move = Move(Geometry=pt, Motion=Y)  # -> Geometry, Transform; disabled
angle = Panel("15")  # disabled
panel_7 = Panel("360")  # disabled
division = Division(A=panel_7, B=angle)  # disabled
number_slider_3 = Slider(1, range=1..100)  # disabled
series = Series(Start=0, Step=angle, Count=division)  # disabled
rad = Radians(Degrees=series)  # disabled
rotate = Rotate(Geometry=move.Geometry, Angle=rad, Plane=xy)  # -> Geometry, Transform; disabled
ln = Line(StartPoint=pt, EndPoint=rotate.Geometry)  # disabled
points = PointList(Points=rotate.Geometry, Size=number_slider_3)  # disabled
ccx = CurveCurve(CurveA=rectangle.Rectangle, CurveB=ln)  # -> flatten(Points), ParamsA, ParamsB; disabled
points_2 = PointList(Points=ccx.Points, Size=number_slider_3)  # disabled
lng = ListLength(List=ccx.Points)  # disabled
panel_8 = Panel("2")  # disabled
panel_9 = Panel(series)  # disabled
panel_10 = Panel("""0
1
2
22
23""")  # disabled
panel_11 = Panel("""4
5
6
7
8""")  # disabled
division_2 = Division(A=lng, B=panel_8)  # disabled
panel_12 = Panel("""12
11
10
14
13""")  # disabled
panel_13 = Panel("""20
19
18
17
16""")  # disabled
item = ListItem(List=ccx.Points, Index=panel_11, Wrap=True)  # disabled
item_2 = ListItem(List=ccx.Points, Index=panel_13, Wrap=True)  # disabled
item_3 = ListItem(List=ccx.Points, Index=panel_10, Wrap=True)  # disabled
item_4 = ListItem(List=ccx.Points, Index=panel_12, Wrap=True)  # disabled
ln_2 = Line(StartPoint=item, EndPoint=item_2)  # disabled
ln_3 = Line(StartPoint=item_3, EndPoint=item_4)  # disabled
crossref = CrossReference(ListA=ln_3, ListB=ln_2, CrossMode=1)  # -> ListA, ListB; disabled
number_slider_4 = Slider(10, range=0..10)  # disabled
ccx_2 = CurveCurve(CurveA=crossref.ListA, CurveB=crossref.ListB)  # -> flatten(Points), ParamsA, ParamsB; disabled
points_3 = PointList(Points=ccx_2.Points, Size=number_slider_3)  # disabled
Z = UnitZ(Factor=number_slider_4)  # disabled
# 24
move_2 = Move(Geometry=ccx_2.Points, Motion=Z)  # -> Geometry, Transform; disabled
move_3 = Move(Geometry=rotate.Geometry, Motion=Z)  # -> Geometry, Transform; disabled
# 25
move_4 = Move(Geometry=ccx.Points, Motion=Z)  # -> Geometry, Transform; disabled
fulllist = CSharpScript(
    arcPoints0=rotate.Geometry,
    boxPoints0=ccx.Points,
    gridPoints0=ccx_2.Points,
    arcPoints1=move_3.Geometry,
    boxPoints1=move_4.Geometry,
    gridPoints1=move_2.Geometry)  # -> out, A, B; inputs arcPoints0: list of Point3d, boxPoints0: list of Point3d, gridPoints0: list of Point3d, arcPoints1: list of Point3d, boxPoints1: list of Point3d, gridPoints1: list of Point3d; disabled
# ---------- fulllist: C# ----------
    List<Point3d> L = new List<Point3d>();
    List<String> L2 = new List<String>();

    //L = arcPoints0.Concat(boxPoints0).Concat(gridPoints0).ToList();
    //L2 = arcPoints0.Concat(boxPoints0).Concat(gridPoints0).Concat(arcPoints1).Concat(boxPoints1).Concat(gridPoints1).ToList().GetRange(73, 73);
    L = arcPoints0.Concat(boxPoints0).Concat(gridPoints0).Concat(arcPoints1).Concat(boxPoints1).Concat(gridPoints1).ToList();
    A = L;
    //B = L2;


    for (int i = 0; i < L.Count ; i++){
      L2.Add("(" + L[i].X + " " + +L[i].Y + " " + +L[i].Z + ")");
    }
    B = L2;
# ---------- end fulllist ----------
points_4 = PointList(Points=fulllist.A, Size=number_slider_3)  # disabled
panel_14 = Panel(fulllist.B)  # disabled
# 25
points_5 = PointList(Points=move_3.Geometry, Size=number_slider_3)  # disabled
points_6 = PointList(Points=move_2.Geometry, Size=number_slider_3)  # disabled
points_7 = PointList(Points=move_4.Geometry, Size=number_slider_3)  # disabled
# faces
# arcs
c_script_3 = CSharpScript(fullList=fulllist.A)  # -> out, A, B, C, D; inputs fullList: list of Point3d; disabled
# ---------- c_script_3: C# ----------
    Mesh m = new Mesh();
    Mesh n = new Mesh();
    List<String> L1 = new List<String>();
    List<String> L2 = new List<String>();


    foreach(Point3d xx in fullList) m.Vertices.Add(xx);


    for(int i = 0; i < fullList.Count / 6 - 1 ;i++){
      m.Faces.AddFace(i, i + 1, fullList.Count / 6 + i + 1, fullList.Count / 6 + i);
    }
    //last Face in list
    m.Faces.AddFace(fullList.Count / 6 - 1, 0, fullList.Count / 6, fullList.Count / 6 + fullList.Count / 6 - 1);

    for(int i = 73; i < fullList.Count / 6 - 1 + 73 ;i++){
      m.Faces.AddFace(i, i + 1, fullList.Count / 6 + i + 1, fullList.Count / 6 + i);
    }
    //last Face in list
    m.Faces.AddFace(fullList.Count / 6 - 1 + 73, 73, fullList.Count / 6 + 73, fullList.Count / 6 + fullList.Count / 6 - 1 + 73);


    //arcPoints1.Count - 1


    A = m;

    for(int i = 0; i < fullList.Count / 6;i++){
      L1.Add(m.Faces[i].A.ToString() + " " + m.Faces[i].B.ToString() + " " + m.Faces[i].C.ToString() + " " + m.Faces[i].D.ToString() + " ");
    }

    for(int i = fullList.Count / 6; i < fullList.Count / 6 * 2;i++){
      L2.Add(m.Faces[i].A.ToString() + " " + m.Faces[i].B.ToString() + " " + m.Faces[i].C.ToString() + " " + m.Faces[i].D.ToString());
    }

    C = L1;
    D = L2;
# ---------- end c_script_3 ----------
concat = Concatenate(FragmentA=c_script_3.C, FragmentB=c_script_3.D)  # disabled
panel_15 = Panel(concat)  # disabled
c_script_4 = CSharpScript(
    arcPoints0=rotate.Geometry,
    boxPoints0=ccx.Points,
    gridPoints0=ccx_2.Points,
    arcPoints1=move_3.Geometry,
    boxPoints1=move_4.Geometry,
    gridPoints1=move_2.Geometry)  # -> out, A, B; inputs arcPoints0: list of Point3d, boxPoints0: list of Point3d, gridPoints0: list of Point3d, arcPoints1: list of Point3d, boxPoints1: list of Point3d, gridPoints1: list of Point3d; disabled
# ---------- c_script_4: C# ----------
    List<Point3d> L = new List<Point3d>();
    List<Point3d> L2 = new List<Point3d>();

    L = arcPoints0.Concat(boxPoints0).Concat(gridPoints0).ToList();
    //L2 = arcPoints0.Concat(boxPoints0).Concat(gridPoints0).Concat(arcPoints1).Concat(boxPoints1).Concat(gridPoints1).ToList().GetRange(73, 73);
    L2 = arcPoints0.Concat(boxPoints0).Concat(gridPoints0).Concat(arcPoints1).Concat(boxPoints1).Concat(gridPoints1).ToList();
    A = L;
    B = L2;
# ---------- end c_script_4 ----------
c_script_5 = CSharpScript(arcPoints1=move_3.Geometry, boxPoints1=move_4.Geometry, gridPoints1=move_3.Geometry)  # -> out, A, B; inputs arcPoints1: list, boxPoints1: list, gridPoints1: list; disabled
# ---------- c_script_5: C# ----------
    Mesh m = new Mesh();
    Mesh n = new Mesh();


    //foreach(Point3d xx in arcPoints0) m.Vertices.Add(xx);
    //foreach(Point3d xx in boxPoints0) m.Vertices.Add(xx);
    //foreach(Point3d xx in gridPoints0) m.Vertices.Add(xx);
    foreach(Point3d xx in arcPoints1) n.Vertices.Add(xx);
    foreach(Point3d xx in boxPoints1) n.Vertices.Add(xx);
    foreach(Point3d xx in gridPoints1) n.Vertices.Add(xx);


    //for(int i = 0; i < arcPoints0.Count - 1 ;i++){
    //  m.Faces.AddFace(i, i + 1, arcPoints0.Count + i + 1, arcPoints0.Count + i);
    //}
    //last Face in list
    //m.Faces.AddFace(arcPoints0.Count - 1, 0, arcPoints0.Count, arcPoints0.Count + boxPoints0.Count - 1);

    for(int i = 0; i < arcPoints1.Count - 1;i++){
      n.Faces.AddFace(i, i + 1, arcPoints1.Count + i + 1, arcPoints1.Count + i);
    }
    n.Faces.AddFace(arcPoints1.Count - 1 , 0, arcPoints1.Count , arcPoints1.Count + boxPoints1.Count - 1 );


    //arcPoints1.Count - 1



    A = n;




    //for(int i = 0; i < m.Faces.Count;i++){
    //
    //  Print(m.Faces[i].A + " " + m.Faces[i].B + " " + m.Faces[i].C + " " + m.Faces[i].D + " ");

    //}
    for(int i = 0; i < n.Faces.Count;i++){

      Print(n.Faces[i].A + " " + n.Faces[i].B + " " + n.Faces[i].C + " " + n.Faces[i].D + " ");

    }
# ---------- end c_script_5 ----------
Y_2 = UnitY(Factor=3)  # disabled
points_8 = PointList(Points=c_script_4.A, Size=number_slider_3)  # disabled
move_5 = Move(Geometry=c_script_4.B, Motion=Y_2)  # -> Geometry, Transform; disabled
c_script_6 = CSharpScript(
    boxPoints0=ccx.Points,
    gridPoints0=ccx_2.Points,
    arcPoints1=move_3.Geometry,
    boxPoints1=move_4.Geometry,
    gridPoints1=move_2.Geometry)  # -> out, A, B; inputs arcPoints0: list of Point3d, boxPoints0: list of Point3d, gridPoints0: list of Point3d, arcPoints1: list of Point3d, boxPoints1: list of Point3d, gridPoints1: list of Point3d; disabled
# ---------- c_script_6: C# ----------
    List<Point3d> L = new List<Point3d>();
    List<Point3d> L2 = new List<Point3d>();



    L = boxPoints0.Concat(gridPoints0).Concat(boxPoints1).Concat(gridPoints1).ToList();
    //L2 = arcPoints0.Concat(boxPoints0).Concat(gridPoints0).Concat(arcPoints1).Concat(boxPoints1).Concat(gridPoints1).ToList().GetRange(73, 73);
    //L2 = boxPoints1.Concat(gridPoints1).ToList();
    A = L;
    B = L2;
# ---------- end c_script_6 ----------
# faces
# patches
c_script_7 = CSharpScript(fullList=fulllist.A, arcPoints0=rotate.Geometry, arcPoints1=move_3.Geometry)  # -> out, A, B, C, D; inputs fullList: list of Point3d, arcPoints0: list of Point3d, arcPoints1: list of Point3d; disabled
# ---------- c_script_7: C# ----------
    Mesh m = new Mesh();
    //Mesh n = new Mesh();
    List<String> L1 = new List<String>();
    // List<String> L2 = new List<String>();


    //foreach(Point3d xx in arcPoints0) m.Vertices.Add(xx);
    //foreach(Point3d xx in arcPoints1) m.Vertices.Add(xx);
    foreach(Point3d xx in fullList) m.Vertices.Add(xx);


    for(int i = 0; i < fullList.Count / 6 - 1 ;i++){
      m.Faces.AddFace(i, i + 1, fullList.Count / 2 + i + 1, fullList.Count / 2 + i);
    }
    //last Face in list
    m.Faces.AddFace(fullList.Count / 6 - 1, 0, fullList.Count / 2, fullList.Count / 2 + fullList.Count / 6 -1);

    A = m;

    for(int i = 0; i < fullList.Count / 6;i++){
      L1.Add("(" + m.Faces[i].A.ToString() + " " + m.Faces[i].B.ToString() + " " + m.Faces[i].C.ToString() + " " + m.Faces[i].D.ToString() + ")");
    }


    C = L1;
    //D = L2;
# ---------- end c_script_7 ----------
mesh_2 = Mesh(c_script_5.A)  # disabled
points_9 = PointList(Points=c_script_6.B, Size=number_slider_3)  # disabled
points_10 = PointList(Points=c_script_6.A, Size=number_slider_3)  # disabled
panel_16 = Panel(c_script_7.A)  # disabled
panel_17 = Panel(c_script_7.C)  # disabled
points_11 = PointList(Points=c_script_4.B, Size=number_slider_3)  # disabled
c_script_8 = CSharpScript(arcPoints1=rotate.Geometry, boxPoints1=ccx.Points, gridPoints1=ccx_2.Points)  # -> out, A, B; inputs arcPoints1: list, boxPoints1: list, gridPoints1: list; disabled
# ---------- c_script_8: C# ----------
    Mesh m = new Mesh();
    Mesh n = new Mesh();


    //foreach(Point3d xx in arcPoints0) m.Vertices.Add(xx);
    //foreach(Point3d xx in boxPoints0) m.Vertices.Add(xx);
    //foreach(Point3d xx in gridPoints0) m.Vertices.Add(xx);
    foreach(Point3d xx in arcPoints1) n.Vertices.Add(xx);
    foreach(Point3d xx in boxPoints1) n.Vertices.Add(xx);
    foreach(Point3d xx in gridPoints1) n.Vertices.Add(xx);


  

    for(int i = 0; i < boxPoints1.Count - 1;i++){
      n.Faces.AddFace(i, i + 1, arcPoints1.Count + i + 1, arcPoints1.Count + i);
    }
    n.Faces.AddFace(arcPoints1.Count - 1, 0, arcPoints1.Count, arcPoints1.Count + boxPoints1.Count - 1);


    //arcPoints1.Count - 1



    A = n;




    //for(int i = 0; i < m.Faces.Count;i++){
    //
    //  Print(m.Faces[i].A + " " + m.Faces[i].B + " " + m.Faces[i].C + " " + m.Faces[i].D + " ");

    //}
    for(int i = 0; i < n.Faces.Count;i++){

      Print(n.Faces[i].A + " " + n.Faces[i].B + " " + n.Faces[i].C + " " + n.Faces[i].D + " ");

    }
# ---------- end c_script_8 ----------
panel_18 = Panel("""0
1
25
24
1
2
26
25
2
3
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""")  # disabled
panel_19 = Panel("""49
50
74
73
50
51
75
74
51
52
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""")  # disabled
# faces
# box
c_script_9 = CSharpScript(inputGroundVertices=panel_18, inputTopVertices=panel_19, fullList=fulllist.A)  # -> out, A, B, C, D; inputs inputGroundVertices: list of Int32, inputTopVertices: list of Int32, fullList: list of Point3d; disabled
# ---------- c_script_9: C# ----------
    List<Point3d> cutList = new List<Point3d>();
    List<Point3d> extendedList = new List<Point3d>();


    Mesh m = new Mesh();
    //Mesh n = new Mesh();
    //List<String> L1 = new List<String>();
    // List<String> L2 = new List<String>();
    //B = input;

    cutList = fullList.GetRange(24, 122);
    cutList.RemoveRange(49, 24);


    foreach(Point3d xx in cutList) m.Vertices.Add(xx);





    for (int i = 0;i < inputGroundVertices.Count - 3; i = i + 4){
      m.Faces.AddFace(inputGroundVertices[i], inputGroundVertices[i + 1], inputGroundVertices[i + 2], inputGroundVertices[i + 3]);
    }
    for (int i = 0;i < inputTopVertices.Count - 3; i = i + 4){
      m.Faces.AddFace(inputTopVertices[i], inputTopVertices[i + 1], inputTopVertices[i + 2], inputTopVertices[i + 3]);
    }

    A = m;
    B = cutList;
# ---------- end c_script_9 ----------
# blocks
# box
c_script_10 = CSharpScript(inputGroundFaces=panel_18, inputTopFaces=panel_19)  # -> out, A, B, C, D; inputs inputGroundFaces: list of Int32, inputTopFaces: list of Int32; disabled
# ---------- c_script_10: C# ----------
    List<int> m = new List<Int32>();
    List<string> L1 = new List<String>();


    for (int i = 0;i < inputGroundFaces.Count - 3; i = i + 4){
      bool continueLoop = true;
      m.Add(inputGroundFaces[i]);
      m.Add(inputGroundFaces[i + 1]);
      m.Add(inputGroundFaces[i + 2]);
      m.Add(inputGroundFaces[i + 3]);
      while (continueLoop){
        m.Add(inputTopFaces[i]);
        m.Add(inputTopFaces[i + 1]);
        m.Add(inputTopFaces[i + 2]);
        m.Add(inputTopFaces[i + 3]);
        continueLoop = false;
      }
    }


    for(int i = 0; i < inputGroundFaces.Count + inputTopFaces.Count ;i = i + 8){
      L1.Add("(" +m[i].ToString() + " " + m[i + 1].ToString() + " " + m[i + 2].ToString() + " " + m[i + 3].ToString() + " " + m[i + 4].ToString() + " " + m[i + 5].ToString() + " " + m[i + 6].ToString() + " " + m[i + 7].ToString()+ ")");
    }

 

    A = m;
    B = L1;
# ---------- end c_script_10 ----------
panel_20 = Panel(c_script_9.B)  # disabled
panel_21 = Panel(c_script_10.B)  # disabled
gradient = Gradient(
    LowerLimit=0,
    UpperLimit=1,
    stops=[0: RGB(234, 38, 0), 0.25: RGB(234, 126, 0), 0.463: RGB(254, 244, 84), 0.75: RGB(173, 203, 249), 1: RGB(75, 107, 169)])  # disabled
vdisex = VectorDisplayEx(Colour=gradient, Width=2)  # disabled
