# Grasshopper definition 6_AnnualOutdoorComfort.ghx (Grasshopper 1.0.7)
# plug-ins: VirtualWindTunnel

# ----
# 1. Geometry &
# Boundary Conditions
panel = Panel("C:\DIVA\WeatherData\USA_IL_Chicago-OHare.Intl.AP.725300_TMY3.epw")
panel_2 = Panel("""0
45
90
135
180
225
270
315""")
geo = Geometry([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])
abl = ABL(WDir=panel_2, Uref=5, Zref=10, Z0=1, ZGround=0, Epw=panel)

# ----
# 2. Simulation Domain
number_slider = Slider(50, range=0..1000)
domaincyl = CylindricalDomain(
    Geometry=geo,
    BCond=abl,
    BlockSize="10",
    SizeOfInnerRectangle=number_slider,
    SizeOfOuterRadius=Slider(300, range=0..1000),
    Height=Slider(80, range=0..1000))  # -> Domain, Mesh, Div

# ----
# 3. Mesh & Simulation
panel_3 = Panel("2")
mset = MeshSettings(AccBuilding=2, AccFeatures="3", AccRefinement=0, AccGround=2, NLayer=panel_3, Mode=2)
rset = RunSettings(
    Iterations="60",
    WriteInterval=20,
    KeepTimeSteps=2,
    Turbulence=1,
    RelaxationFactors=0,
    Mode=0,
    CPUs="2",
    OperationSystem=0)
simulation = Simulation(
    SimulationDomain=domaincyl.Domain,
    WorkingDirectory="C:\test",
    MeshSettings=mset,
    RunSettings=rset,
    RunMeshing=Button(),
    RunSimulation=Button(),
    runWithBlueCFD=True)
residuals = Residuals(Result=simulation, SelectionOfWindDirections=panel_2, X=":", Y=":", Version=1, Run=Button(), visResiduals=True)

# ----
# 4. Probing points & probing
button = Button()
brep = Brep(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)
meshplane = MeshPlane(brep=brep, number=Slider(10, range=1..50))  # -> vertices, faces
point = Point(meshplane.vertices)
visprobes = VisualizeProbes(Res=simulation, Points=point, Name="test", Field=0, Run=button, Culling=True)  # -> Points, Result

# ----
# 5. Post-processing
button_2 = Button()
mrt = MRT(SimulationResult=simulation, ProbingPoints=visprobes.Points, Run=Button())
windfactors = WindFactors(Result=simulation, ProbingPoints=visprobes.Points, U=visprobes.Result, Run=button_2, Interpolation=True)  # -> WindFactors, PedestrianComfort, OffSet
dedata = DeconstructData()  # disabled
dedata_2 = DeconstructData(In=mrt)  # disabled
utci = UTCI(
    SimulationResult=simulation,
    ProbingPoints=visprobes.Points,
    WindFactors=windfactors.WindFactors,
    MeanRadiantTemperature=mrt,
    Run=Button())  # -> UniversalThermalClimateIndexCObject, ComfortableHours
dedata_3 = DeconstructData(In=utci.UniversalThermalClimateIndexCObject)  # disabled
branch = TreeBranch(Tree=dedata_3, Path=Slider(0, range=0..10000), MaintainPaths=True)
cluster = Cluster(data=windfactors.PedestrianComfort)  # -> S, E, data_3
gradient = Gradient(
    LowerLimit=cluster.S,
    UpperLimit=cluster.E,
    Parameter=cluster.data_3,
    stops=[0.103: RGB(0, 0, 255), 0.22: RGB(0, 170, 255), 0.305: RGB(0, 255, 255), 0.398: RGB(0, 255, 188), 0.504: RGB(0, 255, 106), 0.605: RGB(91, 255, 0), 0.699: RGB(184, 255, 0), 0.799: RGB(255, 255, 0), 0.898: RGB(255, 170, 0)])
cluster_2 = Cluster_2(C=visprobes.Points, R=Slider(2, range=0..10))
preview = CustomPreview(Geometry=cluster_2, Material=gradient)

# ----
# 6. Clean
button_3 = Button()
clean = Clean(Directory="C:\test", Mode=2, Run=button_3)

# ==== cluster MeshPlane
number = ClusterInput()
number_2 = Number(number)
settings_custom = SettingsCustom(
    StitchSeams=True,
    SimplePlanes=False,
    Refine=True,
    MinCount=16,
    MaxCount=400,
    AspectRatio=20,
    MaxDistance=0,
    MaxAngle=20,
    MinEdge=number_2,
    MaxEdge=number_2)
brep = ClusterInput()
mesh_brep = MeshBrep(Brep=brep, Settings=settings_custom)
deconstruct_mesh = DeconstructMesh(Mesh=mesh_brep)  # -> Vertices, Faces, Colours, Normals
faces = ClusterOutput(deconstruct_mesh.Faces)
vertices = ClusterOutput(deconstruct_mesh.Vertices)

# ==== cluster Cluster
data = ClusterInput()
data_2 = Data(data)
data_3 = ClusterOutput(data_2)
bnd = Bounds(Numbers=data_2)
dedomain = DeconstructDomain(Domain=bnd)  # -> Start, End
S = ClusterOutput(dedomain.Start)
E = ClusterOutput(dedomain.End)

# ==== cluster Cluster_2
C = ClusterInput()
R = ClusterInput()
circle = CircleCNR(Center=C, Normal=Vector(0, 0, 1), Radius=R)
srf = Surface(circle)
srf_2 = ClusterOutput(srf)
